# Grasshopper definition stl.gh (Grasshopper 1.0.7)

panel = Panel("/Users/tianchen/Research/trussOpt/output/11158_bar/nodes.csv")
panel_2 = Panel("/Users/tianchen/Research/trussOpt/output/11158_bar/members.csv")
python = GhPythonScript(fMembers=panel_2, fNodes=panel)  # -> out, rsPt, rsCrv, r
# ---------- python: Python ----------
__author__ = "tianchen"

import rhinoscriptsyntax as rs
from math import pi, sqrt
with open(fMembers) as f:
    lines = f.readlines()

elem=dict()
elem['n0'] = []
elem['n1'] = []
elem['r'] = []
r = []
for line in lines:
    temp=line.split(",")
    elem['n0'].append(int(temp[0]))
    elem['n1'].append(int(temp[1]))
    
    a = float(temp[2].replace('\r\n',''))
    r.append(sqrt(a/pi)*500)
    

for ri in r:
        if ri<0.5:
            elem['r'].append(0.5)
        else:
            elem['r'].append(ri)
    
with open(fNodes) as f:
    lines = f.readlines()

rsPt =[]
for line in lines:
    temp=line.split(",")
    x = float(temp[0])*5
    y = float(temp[1])*5
    z = float(temp[2].replace('\n',''))
    rsPt.append(rs.AddPoint(x,y,z))
rsCrv=[]
for i in range(len(elem['n0'])):
    rsCrv.append(rs.AddLine(rsPt[elem['n0'][i]],rsPt[elem['n1'][i]]))
    
r = elem['r']
# ---------- end python ----------
number_slider = Slider(0.1, range=0..0.1)
number_slider_2 = Slider(0.5, range=0..1)
number_slider_3 = Slider(5, range=0..10)
neg = Negative(Value=number_slider_3)
neg_2 = Negative(Value=python.r)
pframe = PerpFrame(Curve=python.rsCrv, Parameter=Slider(0, range=0..100))
dom = ConstructDomain(DomainStart=neg, DomainEnd=number_slider_3)
dom_2 = ConstructDomain(DomainStart=neg_2, DomainEnd=python.r)
rectangle = Rectangle(Plane=pframe, XSize=dom, YSize=dom_2, Radius=0)  # -> Rectangle, Length
extrcrv = ExtrudeAlong(Base=rectangle.Rectangle, Curve=python.rsCrv)
