# Grasshopper definition writelattice.gh (Grasshopper 1.0.7)

number_slider = Slider(7, range=0..20)
e_gpa = Slider(200, range=0..100000000)
number_slider_2 = Slider(5, range=0..40)
number_slider_3 = Slider(4, range=0..20)
z_in = Slider(2, range=0..20)
e_gpa_2 = Slider(200, range=0..100000000)
expression = Expression(r=Slider(0.01, range=0..0.01), Expression="π*r^2")
expression_2 = Expression(r=Slider(0.01, range=0..0.01), Expression="π*r^2")
subtraction = Subtraction(A=number_slider, B=Slider(1, range=0..1))
subtraction_2 = Subtraction(A=number_slider_3, B=Slider(1, range=0..1))
division = Division(A=Slider(0.15, range=0..1), B=subtraction)
division_2 = Division(A=Slider(0.15, range=0..1), B=subtraction_2)
force_pt = Point(Point(12, 4, 0))
force_pt_2 = Point(<point referenced from the Rhino model>)
python = GhPythonScript(x_in=Slider(2, range=0..40), y_in=Slider(2, range=0..20), a_i=expression, E_i=e_gpa)  # -> out, ptList, P, crvList, C; inputs x_in: Int32, y_in: Int32
# ---------- python: Python ----------
import rhinoscriptsyntax as rs

import ghpythonlib.treehelpers as th


from math import pi, atan
def ptGrid(x,y,xs,ys):
    pt = []
    for i in range(x):
        for j in range(y):
                pt.append([i*xs,j*ys,0])
    return pt

def calAngle(pt0,pt1):
    if pt1[1]-pt0[1] == 0:
        angle = pi/2
    elif pt1[0]-pt0[0] == 0:
        angle = 0
    else:
        angle = atan((pt1[1]-pt0[1])/(pt1[0]-pt0[0]))
    return angle

def genLine(pt, a_i, E_i):
    
    checkList = []
    crv = []
    for i, pt_i in enumerate(pt):
        for j,pt_j in enumerate(pt[i+1:]):
            
            angle1 = round(calAngle(pt_j,pt_i),7)
            
            if [pt_i, angle1] not in checkList:
                checkList.append([pt_i, angle1])
                crv.append([i,i+j+1, a_i, E_i*10**9])
    return crv
    
ptList = ptGrid(x_in,y_in,1,1)
crvList = genLine(ptList, a_i, E_i)

P = [rs.AddPoint(x) for x in ptList]
C = [rs.AddLine(P[x],P[y]) for x,y,_,_  in crvList]
ptList = th.list_to_tree(ptList)
crvList = th.list_to_tree(crvList)
# ---------- end python ----------
pt = Point(python.P)
constraint_pt = Point([<point referenced from the Rhino model> x9])
python_2 = GhPythonScript(x_in=number_slider, y_in=number_slider, z_in=number_slider, a_i=expression_2, E_i=e_gpa_2, l=division)  # -> out, ptList, P, crvList, C; inputs x_in: Int32, y_in: Int32, z_in: Int32
# ---------- python_2: Python ----------
import rhinoscriptsyntax as rs

import ghpythonlib.treehelpers as th


from math import pi, atan
def ptGrid(x,y,z,xs,ys,zs):
    pt = []
    for i in range(x):
        for j in range(y):
            for k in range(z):
                pt.append([i*xs*1.,j*ys*1.,k*zs*1.])
    return pt

ptList = ptGrid(x_in,y_in,z_in,l,l,l)

P = [rs.AddPoint(x) for x in ptList]
# ---------- end python_2 ----------
python_3 = GhPythonScript(x_in=number_slider_3, y_in=number_slider_3, z_in=number_slider_3, a_i=expression_2, E_i=e_gpa_2, l=division_2)  # -> out, ptList, P, crvList, C; inputs x_in: Int32, y_in: Int32, z_in: Int32
# ---------- python_3: Python ----------
import rhinoscriptsyntax as rs

import ghpythonlib.treehelpers as th


from math import pi, atan
def ptGrid(x,y,z,xs,ys,zs):
    pt = []
    for i in range(x):
        for j in range(y):
            for k in range(z):
                pt.append([i*xs*1.,j*ys*1.,k*zs*1.])
    return pt

def calAngle(pt0,pt1):
    xyL  = ((pt1[1]-pt0[1])**2 + (pt1[0]-pt0[0])**2)**0.5
    #xyzL = ((pt1[2]-pt0[2])**2+(pt1[1]-pt0[1])**2 + (pt1[0]-pt0[0])**2)**0.5
    
    if pt1[2]-pt0[2] == 0:
        phi = 0
    elif xyL == 0:
        phi = pi/2
    else:
        phi   = atan((pt1[2]-pt0[2])/xyL)
    
    if pt1[1]-pt0[1] == 0:
        theta = pi/2
    elif pt1[0]-pt0[0] == 0:
        theta = 0
    else:
        theta = atan((pt1[1]-pt0[1])/(pt1[0]-pt0[0]))
    
    return [phi,theta]

def genLine(pt, a_i, E_i):
    
    checkList = []
    crv = []
    for i, pt_i in enumerate(pt):
        for j,pt_j in enumerate(pt[i+1:]):
            [phi,theta] = calAngle(pt_j,pt_i)
            phi_ = round(phi,7)
            theta_ = round(theta,7)
            
            if [pt_i, phi_, theta_] not in checkList:
                checkList.append([pt_i, phi_, theta_])
                crv.append([i,i+j+1, a_i, E_i*10**9])
    return crv
    
ptList = ptGrid(x_in,y_in,z_in,l,l,l)
crvList = genLine(ptList, a_i, E_i)

P = [rs.AddPoint(x) for x in ptList]
C = [rs.AddLine(P[x],P[y]) for x,y,_,_  in crvList]
ptList = th.list_to_tree(ptList)
crvList = th.list_to_tree(crvList)
# ---------- end python_3 ----------
constraint_pt_2 = Point([<point referenced from the Rhino model> x9])
lng = ListLength(List=pt)
crv = Curve(python_3.C)
pt_2 = Point(python_2.P)
python_4 = GhPythonScript(ptList=python_3.ptList, cPt=constraint_pt_2, fPt=force_pt_2)  # -> out, cStr, fStr; inputs ptList: tree, cPt: list, fPt: list
# ---------- python_4: Python ----------
import rhinoscriptsyntax as rs
import ghpythonlib.treehelpers as th

ptList = th.tree_to_list(ptList)


cPt = [[x.X,x.Y,x.Z] for x in rs.coerce3dpointlist(cPt)]
fPt = [[x.X,x.Y,x.Z] for x in rs.coerce3dpointlist(fPt)]

cId = [ptList.index(cPti) for cPti in cPt]
fId = [ptList.index(fPti) for fPti in fPt]

cStr = []
fStr = []
for cIdi in cId:
    cStr.append([cIdi, 1, 1, 1, 0.])
    
for fIdi in fId:
    fStr.append([fIdi, 0, 1, 0, -1000.])

cStr = th.list_to_tree(cStr)
fStr = th.list_to_tree(fStr)
# ---------- end python_4 ----------
pt_3 = Point(python_3.P)
python_5 = GhPythonScript(ptList=python.ptList, cPt=constraint_pt, fPt=force_pt, m=lng)  # -> out, cStr, fStr; inputs ptList: tree, cPt: list, fPt: list, m: Int32
# ---------- python_5: Python ----------
import rhinoscriptsyntax as rs
import ghpythonlib.treehelpers as th

ptList = th.tree_to_list(ptList)


cPt = [[x.X,x.Y,x.Z] for x in rs.coerce3dpointlist(cPt)]
fPt = [[x.X,x.Y,x.Z] for x in rs.coerce3dpointlist(fPt)]

cId = [ptList.index(cPti) for cPti in cPt]
fId = [ptList.index(fPti) for fPti in fPt]

cStr = []
fStr = []

for j in range(m):
    if j in cId:
        cStr.append([j, 1, 1, 1, 0.])
    else:
        cStr.append([j, 0, 0, 1, 0.])
        
for fIdi in fId:
    fStr.append([fIdi, 0, 1, 0, -10000000.])

cStr = th.list_to_tree(cStr)
fStr = th.list_to_tree(fStr)
# ---------- end python_5 ----------
python_6 = GhPythonScript(
    wTog=Toggle(False),
    wDir="/Users/tianchen/Research/trussOpt/input",
    mName="_bar",
    n=python.ptList,
    m=python.crvList,
    c=python_5.cStr,
    f=python_5.fStr)  # -> out, cStr, fStr; inputs n: tree, m: tree, c: tree, f: tree
# ---------- python_6: Python ----------
import rhinoscriptsyntax as rs
import ghpythonlib.treehelpers as th
from math import pi, atan
import os

nList = th.tree_to_list(n)
mList = th.tree_to_list(m)
cList = th.tree_to_list(c)
fList = th.tree_to_list(f)

mNum = len(mList)

def writeList(wDir, mName, m, l,fName):
    
    fPath = wDir+'/'+str(m)+mName
    # Check whether the specified path exists or not
    if not os.path.exists(fPath):
      # Create a new directory because it does not exist 
      os.makedirs(fPath)
      
    with open(wDir+'/'+str(m)+mName+'/'+fName+'.csv', 'w') as f:
        for item in l:
            f.write(", ".join(map(str, item))+'\n')

if wTog == True:
    writeList(wDir, mName, mNum, nList, 'nodes')
    writeList(wDir, mName, mNum, mList, 'members')
    writeList(wDir, mName, mNum, cList, 'constraints')
    writeList(wDir, mName, mNum, fList, 'forces')
# ---------- end python_6 ----------
python_7 = GhPythonScript(
    wTog=Toggle(False),
    wDir="/Users/tianchen/Research/trussOpt/input",
    mName="_bar",
    n=python_3.ptList,
    m=python_3.crvList,
    c=python_4.cStr,
    f=python_4.fStr)  # -> out, cStr, fStr; inputs n: tree, m: tree, c: tree, f: tree; same code as python_6
